# Grasshopper definition triangular.gh (Grasshopper 1.0.8)
# plug-ins: Kangaroo2 Components

curve = Curve([<curve referenced from the Rhino model> x6])
number_slider = Slider(50, range=0..100)
explode = Explode(Curve=curve, Recursive=True)  # -> Segments, Vertices
curve_2 = Curve([<curve referenced from the Rhino model> x3])
plane_surface = PlaneSurface(Plane=PlaneXY(0, 0, 0), XSize="-15 to 15", YSize="-15 to 15")
end_points = EndPoints(Curve=curve_2)  # -> Start, End
removeduplicatepts = RemoveDuplicatePts(Points=explode.Vertices, Tolerance=0.01)
mesh_surface = MeshSurface(Surface=plane_surface, UCount=number_slider, VCount=number_slider, Overhang=True, Equalize=False)
point = Point(end_points.Start)
point_2 = Point(end_points.End)
removeduplicatepts_2 = RemoveDuplicatePts(Points=point, Tolerance=0.01)
nakedvertices = NakedVertices(Mesh=mesh_surface)  # -> ClothedIndex, NakedIndex, ClothedPts, NakedPts
closest_point = ClosestPoint(Point=removeduplicatepts, Cloud=nakedvertices.NakedPts)  # -> ClosestPoint, CPIndex, Distance
unit_z = UnitZ(Factor=Slider(0, range=-1..1))
closest_point_2 = ClosestPoint(Point=point_2, Cloud=nakedvertices.ClothedPts)  # -> ClosestPoint, CPIndex, Distance
closest_point_3 = ClosestPoint(Point=removeduplicatepts_2, Cloud=nakedvertices.ClothedPts)  # -> ClosestPoint, CPIndex, Distance
point_3 = Point([nakedvertices.ClothedPts, nakedvertices.NakedPts])
load = Load(Point=point_3, ForceVector=unit_z, Weighting=1)
anchor = Anchor(Point=closest_point_3.ClosestPoint, Target=removeduplicatepts_2, Strength=10000)
edgelengths = EdgeLengths(Mesh=mesh_surface, LengthFactor=1, Strength=1)
anchor_2 = Anchor(Point=closest_point.ClosestPoint, Target=removeduplicatepts, Strength=10000)
anchor_3 = Anchor(Point=closest_point_2.ClosestPoint, Target=point_2, Strength=10000)
show = Show(G=mesh_surface)
bouncysolver = BouncySolver(
    GoalObjects=[show, anchor_2, edgelengths, anchor_3, load, anchor],
    Reset=Button(),
    Threshold=1e-15,
    Tolerance=0.0001,
    Damping=0.99,
    Iterations=10,
    On=Toggle(False))  # -> I, V, O
